% Simulink data dictionary ElectricPowertrain_data.sldd
% references BatteryManagement_data.sldd
% references MotorControl_data.sldd
% references Contactors_data.sldd
% references Driver_data.sldd

tSim = Simulink.Parameter(0.005, Unit="s")  % Simulation Step Time for Electric Powertrain Model

PlantOutput_BUS = Simulink.Bus()
  VCUKIVT: double, Unit="V"  % CUK IVT Voltage Measurement
  IESIVT: double, Unit="A"  % ES IVT Current Measurement
  VESDCLink: double, Unit="V"  % ES Voltage
  VESIVT: double, Unit="V"  % ES IVT Voltage Measurement
  BContactorsClosed: boolean  % Boolean Indicating Contactors Closed
  VESCell: double[6], Unit="V"  % Vector of Cell Voltages
  ICUKIVT: double, Unit="A"  % CUK IVT Current Measurement

ControllerCmds_BUS = Simulink.Bus()
  BMSCmds: Bus: BMSCmds_BUS  % Commands of BMS Controller
  ContactorsCmds: Bus: ContactorsCmds_BUS  % Commands of Contactors Controller

PhysicalInputs_BUS = Simulink.Bus()
  BServiceDisconnectPos: boolean  % Positive Service Disconnect Switch (Connected/Disconnected)
  BServiceDisconnectNeg: boolean  % Negative Service Disconnect Switch (Connected/Disconnected)